# Grasshopper definition DataFromZED.gh (Grasshopper 1.0.8)
# plug-ins: gHowl

network_source = NetworkSource()  # -> NetworkAdapterIsUp, AdapterProperties, LocalIpAddress
udp_receiver = UDPReceiver(Address=network_source.LocalIpAddress, Port="8989", Pattern=0)  # -> Info, Data
cluster = Cluster(text=udp_receiver.Data)
point = Point(cluster)

panel = Panel("""0
1""")
panel_2 = Panel("""1
2
3
4""")
panel_3 = Panel("""1
5
6
7""")
panel_4 = Panel("""2
8
9
10""")
panel_5 = Panel("""5
11
12
13""")
panel_6 = Panel("""0
14
16""")
panel_7 = Panel("""0
15
17""")
list_item = ListItem(List=point, Index=panel, Wrap=True)
list_item_2 = ListItem(List=point, Index=panel_2, Wrap=True)
list_item_3 = ListItem(List=point, Index=panel_3, Wrap=True)
list_item_4 = ListItem(List=point, Index=panel_4, Wrap=True)
list_item_5 = ListItem(List=point, Index=panel_5, Wrap=True)
list_item_6 = ListItem(List=point, Index=panel_6, Wrap=True)
list_item_7 = ListItem(List=point, Index=panel_7, Wrap=True)
polyline = PolyLine(Vertices=list_item, Closed=False)
polyline_2 = PolyLine(Vertices=list_item_2, Closed=False)
polyline_3 = PolyLine(Vertices=list_item_3, Closed=False)
polyline_4 = PolyLine(Vertices=list_item_4, Closed=False)
polyline_5 = PolyLine(Vertices=list_item_5, Closed=False)
polyline_6 = PolyLine(Vertices=list_item_6, Closed=False)
polyline_7 = PolyLine(Vertices=list_item_7, Closed=False)
merge = Merge(
    Data1=polyline,
    Data2=polyline_2,
    Data3=polyline_3,
    Data4=polyline_4,
    Data5=polyline_5,
    Data6=polyline_6,
    Data7=polyline_7)

point_2 = Point(<point referenced from the Rhino model>)
curve = Curve(<curve referenced from the Rhino model>)
curve_2 = Curve(<curve referenced from the Rhino model>)
point_3 = Point(<point referenced from the Rhino model>)
curve_3 = Curve(<curve referenced from the Rhino model>)
curve_4 = Curve(<curve referenced from the Rhino model>)
construct_plane = ConstructPlane(Origin=point_2, XAxis=curve, YAxis=curve_2)
construct_plane_2 = ConstructPlane(Origin=point_3, XAxis=curve_3, YAxis=curve_4)
orient = Orient(Geometry=merge, Source=construct_plane, Target=construct_plane_2)  # -> Geometry, Transform

# ==== cluster Cluster
text = ClusterInput()
text_split = TextSplit(Text=text)
c_script = CSharpScript(x=text_split)  # -> out, a; inputs x: list of String
# ---------- c_script: C# usings ----------
using System.Linq;
# ---------- c_script: C# ----------
    List<List<string>> groups = new List<List<string>>();
    List<string> currentGroup = new List<string>();


    foreach (string item in x)
    {
      if (item == "")
      {
        if (currentGroup.Any())
        {
          groups.Add(currentGroup);
          currentGroup = new List<string>();
        }
      }
      else
      {
        currentGroup.Add(item);
      }
    }

    if (currentGroup.Any())
    {
      groups.Add(currentGroup);
    }

    List<string> combinedGroup = groups.Select(sublist => string.Join("\n", sublist)).ToList();
    a = combinedGroup.ToArray();
# ---------- end c_script ----------
text_split_2 = TextSplit(Text=c_script.a)
split_list = SplitList(List=text_split_2, Index="1")  # -> ListA, ListB
text_split_3 = TextSplit(Text=split_list.ListB, Separators=" ")  # -> simplify(Result)
list_item = ListItem(List=text_split_3, Index=0, Wrap=True)  # -> Item, Item1, Item2
construct_point = ConstructPoint(XCoordinate=list_item.Item, YCoordinate=list_item.Item1, ZCoordinate=list_item.Item2)
tree_statistics = TreeStatistics(Tree=construct_point)  # -> Paths, Length, Count
list_item_2 = ListItem(List=reverse(tree_statistics.Paths), Index=0, Wrap=True)
text_length = TextLength(Text=list_item_2)
equality = Equality(FirstNumber=text_length, SecondNumber="4")  # -> Equality, Inequality
stream_gate = StreamGate(Stream=construct_point, Gate=equality.Equality)  # -> Target0, Target1
shift_paths = ShiftPaths(Data=stream_gate.Target0, Offset=-1)
construct_point_2 = ConstructPoint(XCoordinate=0, YCoordinate=0, ZCoordinate=0)
stream_filter = StreamFilter(Gate=equality.Equality, Stream0=shift_paths, Stream1=stream_gate.Target1)
point = Point(stream_filter)
distance = Distance(PointA=point, PointB=construct_point_2)
smaller_than = SmallerThan(FirstNumber=distance, SecondNumber="0.001")  # -> SmallerThan, OrEqualTo
member_index = MemberIndex(Set=smaller_than.SmallerThan, Member=Toggle(True))  # -> Index, Count
null_placeholder = NullPlaceholder()
replace_items = ReplaceItems(List=point, Item=null_placeholder, Indices=member_index.Index, Wrap=False)
stream_gate_2 = StreamGate(Stream=replace_items, Gate=equality.Equality)  # -> Target0, Target1
flatten_tree = FlattenTree(Tree=stream_gate_2.Target1, Path="{0}")
stream_filter_2 = StreamFilter(Gate=equality.Equality, Stream0=stream_gate_2.Target0, Stream1=flatten_tree)
pointlist = Point(stream_filter_2)
pointlist_2 = ClusterOutput(pointlist)
