# Grasshopper definition HL-Unity-GH(with QR Code).gh (Grasshopper 1.0.8)
# plug-ins: GHxUnity

# ---- group: Get the Position of HoloLens and Match the 3d Model
trigger = Trigger(Interval=100, TimerInterval=100, Target=unity2gh_hl)
unity2gh_hl = Unity2GH_HL()
file_path = FilePath("C:\Users\77950\Desktop\H-MR_Workshop\RIU-ready\GH-Unity_Communication\RIU+MR\Assets\Prefabs\device-hl2.3dm")
import_3dm = Import3DM(File=file_path, Layer="*", Name="*")
xz_plane = XZPlane(Origin=Point(0, 0, 0))
orient = Orient(Geometry=import_3dm, Source=xz_plane, Target=unity2gh_hl)  # -> Geometry, Transform

# ---- group: Get Eye Gace Direction
trigger_2 = Trigger(Interval=100, TimerInterval=100, Target=unity2gh_eye)
unity2gh_eye = Unity2GH_Eye()  # -> Eye_Pos, Eye_Dir
line_sdl = LineSDL(Start=unity2gh_eye.Eye_Pos, Direction=unity2gh_eye.Eye_Dir, Length=1)

# ---- group: Get QR Code Pose from Unity
trigger_3 = Trigger(Interval=100, TimerInterval=100, Target=unity2gh_qrcode)
unity2gh_qrcode = Unity2GH_QRCode()
deconstruct_plane = DeconstructPlane(Plane=unity2gh_qrcode)  # -> Origin, XAxis, YAxis, ZAxis
negative = Negative(Value=Slider(0.12, range=0..0.12))
negative_2 = Negative(Value=deconstruct_plane.ZAxis)
construct_domain = ConstructDomain(DomainStart="0", DomainEnd=Slider(0.12, range=0..0.12))
construct_domain_2 = ConstructDomain(DomainStart=negative, DomainEnd="0")
construct_plane = ConstructPlane(Origin=deconstruct_plane.Origin, XAxis=deconstruct_plane.XAxis, YAxis=negative_2)
rectangle = Rectangle(Plane=construct_plane, XSize=construct_domain, YSize=construct_domain_2, Radius=0)  # -> Rectangle, Length
boundary_surfaces = BoundarySurfaces(Edges=rectangle.Rectangle)

# ---- group: Send QR Code Information from GH to Unity
xy_plane = XYPlane(Origin=Point(0, 0, 0))
deconstruct_plane_2 = DeconstructPlane(Plane=xy_plane)  # -> Origin, XAxis, YAxis, ZAxis
gh2unity_qrcode = GH2Unity_QRCode(Position=deconstruct_plane_2.Origin, XAxis=deconstruct_plane_2.XAxis, YAxis=deconstruct_plane_2.YAxis, Content="MR_1")

# ----
orient_2 = Orient(Geometry=orient.Geometry, Source=xy_plane, Target=construct_plane)  # -> Geometry, Transform
orient_3 = Orient(Geometry=line_sdl, Source=xy_plane, Target=construct_plane)  # -> Geometry, Transform

# ---- group: Get Hand Joints Position
trigger_4 = Trigger(Interval=100, TimerInterval=100, Target=unity2gh_hand)
unity2gh_hand = Unity2GH_Hand()  # -> Left_Hand_Pos, Left_Hand_Up, Left_Hand_Right, Right_Hand_Pos, Right_Hand_Up, Right_Hand_Right
panel = Panel("""1
2
3
4
5""")
panel_2 = Panel("""1
6
7
8
9
10""")
panel_3 = Panel("""1
11
12
13
14
15""")
panel_4 = Panel("""1
16
17
18
19
20""")
panel_5 = Panel("""1
2
3
4
5""")
panel_6 = Panel("""1
6
7
8
9
10""")
panel_7 = Panel("""1
11
12
13
14
15""")
panel_8 = Panel("""1
16
17
18
19
20""")
panel_9 = Panel("""1
21
22
23
24
25""")
panel_10 = Panel("""1
21
22
23
24
25""")

# ----
orient_4 = Orient(Geometry=unity2gh_hand.Left_Hand_Pos, Source=xy_plane, Target=construct_plane)  # -> Geometry, Transform
orient_5 = Orient(Geometry=unity2gh_hand.Right_Hand_Pos, Source=xy_plane, Target=construct_plane)  # -> Geometry, Transform

# ---- group: Get Hand Joints Position (continued)
point = Point(orient_4.Transform)
point_2 = Point(orient_5.Geometry)
list_item = ListItem(List=point, Index=panel, Wrap=True)
list_item_2 = ListItem(List=point, Index=panel_2, Wrap=True)
list_item_3 = ListItem(List=point, Index=panel_3, Wrap=True)
list_item_4 = ListItem(List=point, Index=panel_4, Wrap=True)
list_item_5 = ListItem(List=point, Index=panel_9, Wrap=True)
list_item_6 = ListItem(List=point_2, Index=panel_5, Wrap=True)
list_item_7 = ListItem(List=point_2, Index=panel_6, Wrap=True)
list_item_8 = ListItem(List=point_2, Index=panel_7, Wrap=True)
list_item_9 = ListItem(List=point_2, Index=panel_8, Wrap=True)
list_item_10 = ListItem(List=point_2, Index=panel_10, Wrap=True)
polyline = PolyLine(Vertices=list_item, Closed=False)
polyline_2 = PolyLine(Vertices=list_item_2, Closed=False)
polyline_3 = PolyLine(Vertices=list_item_3, Closed=False)
polyline_4 = PolyLine(Vertices=list_item_4, Closed=False)
polyline_5 = PolyLine(Vertices=list_item_5, Closed=False)
polyline_6 = PolyLine(Vertices=list_item_6, Closed=False)
polyline_7 = PolyLine(Vertices=list_item_7, Closed=False)
polyline_8 = PolyLine(Vertices=list_item_8, Closed=False)
polyline_9 = PolyLine(Vertices=list_item_9, Closed=False)
polyline_10 = PolyLine(Vertices=list_item_10, Closed=False)

# ---- group: Send Mesh from GH to Unity
brep = Brep(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)

# ----
orient_6 = Orient(Geometry=brep, Source=xy_plane, Target=construct_plane)  # -> Geometry, Transform

# ---- group: Send Mesh from GH to Unity (continued)
gh2unity_mesh = GH2Unity_Mesh(Meshes=orient_6.Geometry, Mats=ColourSwatch(SwatchColor=RGB(255, 255, 255)))  # -> Outmeshes, Outmats
