# Grasshopper definition HL-Unity-GH(withouot QR Code).gh (Grasshopper 1.0.8)
# plug-ins: GHxUnity

# ---- group: Get the Position of HoloLens and Match the 3d Model
trigger = Trigger(Interval=100, TimerInterval=100, Target=unity2gh_hl)
unity2gh_hl = Unity2GH_HL()
file_path = FilePath("C:\Users\77950\Desktop\H-MR_Workshop\RIU-ready\GH-Unity_Communication\RIU+MR\Assets\Prefabs\device-hl2.3dm")
import_3dm = Import3DM(File=file_path, Layer="*", Name="*")
xz_plane = XZPlane(Origin=Point(0, 0, 0))
orient = Orient(Geometry=import_3dm, Source=xz_plane, Target=unity2gh_hl)  # -> Geometry, Transform

# ---- group: Get Eye Gace Direction
trigger_2 = Trigger(Interval=100, TimerInterval=100, Target=unity2gh_eye)
unity2gh_eye = Unity2GH_Eye()  # -> Eye_Pos, Eye_Dir
line_sdl = LineSDL(Start=unity2gh_eye.Eye_Pos, Direction=unity2gh_eye.Eye_Dir, Length=1)

# ---- group: Get Hand Joints Position
trigger_3 = Trigger(Interval=100, TimerInterval=100, Target=unity2gh_hand)
unity2gh_hand = Unity2GH_Hand()  # -> Left_Hand_Pos, Left_Hand_Up, Left_Hand_Right, Right_Hand_Pos, Right_Hand_Up, Right_Hand_Right
point = Point(unity2gh_hand.Left_Hand_Pos)
point_2 = Point(unity2gh_hand.Right_Hand_Pos)
panel = Panel("""1
2
3
4
5""")
panel_2 = Panel("""1
6
7
8
9
10""")
panel_3 = Panel("""1
11
12
13
14
15""")
panel_4 = Panel("""1
2
3
4
5""")
panel_5 = Panel("""1
6
7
8
9
10""")
panel_6 = Panel("""1
11
12
13
14
15""")
panel_7 = Panel("""1
16
17
18
19
20""")
panel_8 = Panel("""1
21
22
23
24
25""")
panel_9 = Panel("""1
16
17
18
19
20""")
panel_10 = Panel("""1
21
22
23
24
25""")
list_item = ListItem(List=point, Index=panel, Wrap=True)
list_item_2 = ListItem(List=point, Index=panel_2, Wrap=True)
list_item_3 = ListItem(List=point, Index=panel_3, Wrap=True)
list_item_4 = ListItem(List=point, Index=panel_7, Wrap=True)
list_item_5 = ListItem(List=point, Index=panel_8, Wrap=True)
list_item_6 = ListItem(List=point_2, Index=panel_4, Wrap=True)
list_item_7 = ListItem(List=point_2, Index=panel_5, Wrap=True)
list_item_8 = ListItem(List=point_2, Index=panel_6, Wrap=True)
list_item_9 = ListItem(List=point_2, Index=panel_9, Wrap=True)
list_item_10 = ListItem(List=point_2, Index=panel_10, Wrap=True)
polyline = PolyLine(Vertices=list_item, Closed=False)
polyline_2 = PolyLine(Vertices=list_item_2, Closed=False)
polyline_3 = PolyLine(Vertices=list_item_3, Closed=False)
polyline_4 = PolyLine(Vertices=list_item_4, Closed=False)
polyline_5 = PolyLine(Vertices=list_item_5, Closed=False)
polyline_6 = PolyLine(Vertices=list_item_6, Closed=False)
polyline_7 = PolyLine(Vertices=list_item_7, Closed=False)
polyline_8 = PolyLine(Vertices=list_item_8, Closed=False)
polyline_9 = PolyLine(Vertices=list_item_9, Closed=False)
polyline_10 = PolyLine(Vertices=list_item_10, Closed=False)

# ---- group: Send Mesh from GH to Unity
brep = Brep(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)
gh2unity_mesh = GH2Unity_Mesh(Meshes=brep, Mats=ColourSwatch(SwatchColor=RGB(255, 255, 255)))  # -> Outmeshes, Outmats
