# Grasshopper definition CellularAutomata(OpenWith_R8).gh (Grasshopper 1.0.8)
# plug-ins: jSwan, RhinoCodePluginGH, gHowl

# ---- group: Check the system PATH variable
python_3_script = Python3Script()  # -> out, a
# ---------- python_3_script: Python ----------
import sys

a = sys.path
# ---------- end python_3_script ----------
panel = Panel(python_3_script.a)

# ---- group: Create_instances & SET_SpecialBoxes
python_3_script_2 = Python3Script()  # -> out, all_boxes, special_boxes, queue_boxes; disabled
# ---------- python_3_script_2: Python ----------
import numpy as np
import random
import Rhino.Geometry as rg
from collections import deque
import scriptcontext as sc
from Box import Box

# Function to instantiate boxes from the grid data
def instantiate_boxes_from_grid(grid_data):
    boxes = []
    special_boxes = []

    # Counter for 'with SLS' boxes
    with_sls_count = 0
    sensors = deque(['SLS_01', 'SLS_02', 'SLS_03'])

    # First pass: create all boxes
    for z in range(grid_data.shape[0]):
        for y in range(grid_data.shape[1]):
            for x in range(grid_data.shape[2]):
                if grid_data[z, y, x] == 1:
                    position = rg.Point3d(x * Box.size, y * Box.size, z * Box.size)  # Create Rhino.Geometry.Point3d
                    category = 'grid'
                    if random.random() < 0.1 and with_sls_count < 3:
                        box_type = 'with SLS'
                        with_sls_count += 1
                        sound_sensor = sensors.popleft()  # Assign a sound sensor
                    else:
                        box_type = 'without SLS'
                        sound_sensor = None

                    box = Box(category, box_type, position, sound_sensor = sound_sensor)
                    boxes.append(box)
                    if box_type == 'with SLS':
                        special_boxes.append(box)


    # Second pass: ensure at least 3 special boxes
    for box in boxes:
        if with_sls_count >= 3:
            break
        if box.type == 'without SLS':
            box.type = 'with SLS'
            box.sound_level = None  # Set appropriate sound level if needed
            box.sound_sensor = sensors.popleft()  # Assign a sound sensor
            special_boxes.append(box)
            with_sls_count += 1

    return boxes, special_boxes

# Function to generate boxes in the queue
def generate_queue_boxes(box_queue, grid_size_x, spacing=Box.size):
    queue_boxes = []
    offset_x = grid_size_x * Box.size + spacing  # Position along +x axis side of the grid

    index = 0
    for i in range(len(box_queue) // 15 + 1):
        for y in range(5):
            for z in range(3):
                if index < len(box_queue):
                    position = rg.Point3d(offset_x + i * Box.size, y * Box.size, z * Box.size)
                    box = Box('queue', 'without SLS', position)
                    queue_boxes.append(box)
                    index += 1
                else:
                    break

    return queue_boxes

# Define the new 5x5x5 grid as a numpy array
grid_data = grid

# Instantiate boxes from grid data
grid_boxes, special_boxes = instantiate_boxes_from_grid(grid_data)

# Box queue data
box_queue = box_queue

# Generate queue boxes
queue_boxes = generate_queue_boxes(box_queue, grid_size_x=5, spacing=Box.size*2)

# Combine all boxes
all_boxes = grid_boxes + queue_boxes

# Print positions of special boxes
print("Positions of special boxes:")
for box in special_boxes:
    # Format positions to 2 decimal places
    x = round(box.position.X, 2)
    y = round(box.position.Y, 2)
    z = round(box.position.Z, 2)
    print(f"Position: ({x}, {y}, {z}), Type: {box.type}, SLS: {box.sound_sensor}")

"""
pos_all = []
for box in all_boxes:
    pos_all.append(box.position)

pos_special = []
for box in special_boxes:
    pos_special.append(box.position)
"""

sc.sticky["all_boxes"] = all_boxes
# ---------- end python_3_script_2 ----------

# ----
trigger = Trigger(Interval=100, TimerInterval=100, Target=python_3_script_9)  # disabled
button = Button()  # disabled

# ---- group: Real-time_Assign_SoundLevelValue_to_SpecialBoxes
trigger_2 = Trigger(Interval=100, TimerInterval=100, Target=python_3_script_3)
python_3_script_3 = Python3Script()  # -> out, a, b
# ---------- python_3_script_3: Python ----------
import scriptcontext as sc
import Rhino.Geometry as rg

all_boxes = sc.sticky["all_boxes"]
p_list=[]
text_list=[]
for box in all_boxes:
    if box.type == "special":
        if box.sound_sensor == "SLS_01":
            box.sound_level = sc.sticky["Sound_Level_01"]
        if box.sound_sensor == "SLS_02":
            box.sound_level = sc.sticky["Sound_Level_02"]
        if box.sound_sensor == "SLS_03":
            box.sound_level = sc.sticky["Sound_Level_03"]
        p = rg.Point3d(box.position.X+0.2,box.position.Y+0.2, box.position.Z+0.4)
        p_list.append(p)
        text_list.append(str(box.sound_sensor) + "\n" + str(box.sound_level))
a=p_list
b=text_list
# ---------- end python_3_script_3 ----------
annotation_text_settings = AnnotationTextSettings(TextHeight=Slider(0.5, range=0..10))  # -> TextSettings, Font, TextHeight, TextGap, MaskFrame, MaskColour, MaskMargins, ViewOriented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
text_entity = TextEntity(Plane=python_3_script_3.a, Text=python_3_script_3.b, TextSettings=annotation_text_settings.TextSettings)  # -> TextEntity, Plane, Text, TextSettings

# ----
trigger_3 = Trigger(Interval=20, TimerInterval=20, Target=python_3_script_14)

# ---- group: Initialize_Grid&Queue
initial_grid_boxes = Slider(36, range=0..50)
total_boxes = Slider(50, range=0..100)
python_3_script_4 = Python3Script(TOTAL_BOXES=total_boxes, INITIAL_GRID_BOXES=initial_grid_boxes)  # -> out, grid, box_queue; inputs TOTAL_BOXES: Int32, INITIAL_GRID_BOXES: Int32
# ---------- python_3_script_4: Python ----------
import numpy as np
import random
from collections import deque
import Rhino.Geometry as rg
import scriptcontext as sc
import ghpythonlib.components as ghcomp
import Grasshopper as gh

if(INITIAL_GRID_BOXES > TOTAL_BOXES):
    error_message = "INITIAL_GRID_BOXES value cannot be larger than TOTAL_BOXES value!"
    #ghenv.Component.AddRuntimeMessage(gh.Kernel.GH_RuntimeMessageLevel.Error, error_message)
    raise ValueError(error_message)

# Define the grid size
GRID_SIZE = 5
#TOTAL_BOXES = 50
#INITIAL_GRID_BOXES = 15
INITIAL_QUEUE_BOXES = TOTAL_BOXES - INITIAL_GRID_BOXES

# Initialize the 3D grid with random scattered boxes (1 represents a box, 0 represents an empty space)
def initialize_grid_and_queue():
    grid = np.zeros((GRID_SIZE, GRID_SIZE, GRID_SIZE), dtype=int)
    box_queue = deque()

    placed_boxes = 0
    special_boxes_count = 0
    
    while placed_boxes < INITIAL_GRID_BOXES:
        z = random.randint(0, GRID_SIZE-1)
        y = random.randint(0, GRID_SIZE-1)
        x = random.randint(0, GRID_SIZE-1)
        
        # Gravity rule
        if z == 0 or grid[z-1, y, x] == 1:
            if grid[z, y, x] == 0:
                grid[z, y, x] = 1
                placed_boxes += 1
    
    for _ in range(INITIAL_QUEUE_BOXES):
        box_queue.append(1)
    
    return grid, box_queue



grid, box_queue = initialize_grid_and_queue()

# sc.sticky["Init_grid"] = grid
# sc.sticky["Init_box_queue"] = box_queue
# ---------- end python_3_script_4 ----------

# ---- group: GET_SoundLevel
number_slider = Slider(12355, range=0..100000)  # disabled
number_slider_2 = Slider(12345, range=0..100000)  # disabled
number_slider_3 = Slider(12365, range=0..100000)  # disabled
panel_2 = Panel("0.0.0.0")  # disabled
panel_3 = Panel("0.0.0.0")  # disabled
panel_4 = Panel("0.0.0.0")  # disabled
udp_receiver = UDPReceiver(Address=panel_2, Port=number_slider_2, Pattern=0)  # -> Info, Data; disabled
udp_receiver_2 = UDPReceiver(Address=panel_3, Port=number_slider, Pattern=0)  # -> Info, Data; disabled
udp_receiver_3 = UDPReceiver(Address=panel_4, Port=number_slider_3, Pattern=0)  # -> Info, Data; disabled
python_3_script_5 = Python3Script(Sound_Level_01=udp_receiver.Data, Sound_Level_02=udp_receiver_2.Data, Sound_Level_03=udp_receiver_3.Data)  # -> out; disabled
# ---------- python_3_script_5: Python ----------
import random
import scriptcontext as sc

print(Sound_Level_01)
print(Sound_Level_02)
print(Sound_Level_03)

sc.sticky["Sound_Level_01"] = Sound_Level_01
sc.sticky["Sound_Level_02"] = Sound_Level_02
sc.sticky["Sound_Level_03"] = Sound_Level_03
# ---------- end python_3_script_5 ----------
panel_5 = Panel(python_3_script_5)  # disabled

# ---- group: 3 in juxtaposition (cause floating issue)
python_3_script_6 = Python3Script()  # -> out, a
# ---------- python_3_script_6: Python ----------
import random
import Rhino.Geometry as rg
from Box import Box

def detect_and_relocate():
    # Define the number of decimal places to round to
    precision = 3
    # Define a small tolerance value for floating-point comparisons
    tolerance = 1e-3

    # Find all grid boxes
    grid_boxes = [box for box in Box.instances if box.category == 'grid']
    
    # Sort boxes by position for easier comparison
    grid_boxes.sort(key=lambda box: (round(box.position.X, precision), round(box.position.Y, precision), round(box.position.Z, precision)))
    
    # Create a 3D dictionary to store the positions of the grid boxes
    grid_dict = {}
    for box in grid_boxes:
        x = round(box.position.X, precision)
        y = round(box.position.Y, precision)
        z = round(box.position.Z, precision)
        if (x, y, z) not in grid_dict:
            grid_dict[(x, y, z)] = box

    # Helper function to check if three boxes are adjacent in a direction
    def are_boxes_adjacent(box1, box2, box3, axis):
        if axis == 'x':
            return round(abs(box1.position.X - box2.position.X), precision) == Box.size and round(abs(box2.position.X - box3.position.X), precision) == Box.size
        elif axis == 'y':
            return round(abs(box1.position.Y - box2.position.Y), precision) == Box.size and round(abs(box2.position.Y - box3.position.Y), precision) == Box.size
        elif axis == 'z':
            return round(abs(box1.position.Z - box2.position.Z), precision) == Box.size and round(abs(box2.position.Z - box3.position.Z), precision) == Box.size
        return False

    # Initialize box_to_move as None
    box_to_move = None

    """
    x = 0.8
    y = 0.4
    z = 0
    test = grid_dict[(x, y, z)]
    a1 = (x, round(y + Box.size, precision), z) in grid_dict
    a2 = (x, round(y + 2 * Box.size, precision), z) in grid_dict
    """

    # Iterate through the grid to find three adjacent boxes
    for (x, y, z) in grid_dict.keys():
        # Check x-direction
        if (round(x + Box.size, precision), y, z) in grid_dict and (round(x + 2 * Box.size, precision), y, z) in grid_dict:
            box1 = grid_dict[(x, y, z)]
            box2 = grid_dict[(round(x + Box.size, precision), y, z)]
            box3 = grid_dict[(round(x + 2 * Box.size, precision), y, z)]
            if are_boxes_adjacent(box1, box2, box3, 'x'):
                box_to_move = random.choice([box1, box2, box3])
                break
        
        # Check y-direction
        if (x, round(y + Box.size, precision), z) in grid_dict and (x, round(y + 2 * Box.size, precision), z) in grid_dict:
            box1 = grid_dict[(x, y, z)]
            box2 = grid_dict[(x, round(y + Box.size, precision), z)]
            box3 = grid_dict[(x, round(y + 2 * Box.size, precision), z)]
            if are_boxes_adjacent(box1, box2, box3, 'y'):
                box_to_move = random.choice([box1, box2, box3])
                break
        
        """
        # Check z-direction
        if (x, y, round(z + Box.size, precision)) in grid_dict and (x, y, round(z + 2 * Box.size, precision)) in grid_dict:
            box1 = grid_dict[(x, y, z)]
            box2 = grid_dict[(x, y, round(z + Box.size, precision))]
            box3 = grid_dict[(x, y, round(z + 2 * Box.size, precision))]
            if are_boxes_adjacent(box1, box2, box3, 'z'):
                box_to_move = random.choice([box1, box2, box3])
                break
        """

    # Proceed only if a box has been selected to move
    if box_to_move:
        box_to_move.category = 'queue'
        
        # Update counters
        Box.num_boxes_grid -= 1
        Box.num_boxes_queue += 1
        
        grid_len_x = 2
        spacing = 2 * Box.size
        # Determine new position based on queue indexing logic
        queue_boxes = [box for box in Box.instances if box.category == 'queue']
        queue_boxes.sort(key=lambda box: (round(box.position.X, precision), round(box.position.Y, precision), round(box.position.Z, precision)))
        index = len(queue_boxes) - 1

        new_x_position = grid_len_x + spacing + index // 15 * Box.size
        new_y_position = (index % 15) // 3 * Box.size
        new_z_position = (index % 15) % 3 * Box.size
        
        box_to_move.position = rg.Point3d(new_x_position, new_y_position, new_z_position)

detect_and_relocate()
# ---------- end python_3_script_6 ----------

# ----
python_3_script_7 = Python3Script(y=button)  # -> out, a, b, special_grid_boxes, grid, box_queue, special_boxes; disabled
# ---------- python_3_script_7: Python ----------
import numpy as np
import random
from collections import deque
import Rhino.Geometry as rg
import scriptcontext as rs


# Define the grid size
GRID_SIZE = 5
TOTAL_BOXES = 50
INITIAL_GRID_BOXES = 25
INITIAL_QUEUE_BOXES = TOTAL_BOXES - INITIAL_GRID_BOXES
box_size = 0.4  # Adjust the size of the boxes as needed

# Initialize the 3D grid with random scattered boxes (1 represents a box, 0 represents an empty space)
def initialize_grid_and_queue():
    grid = np.zeros((GRID_SIZE, GRID_SIZE, GRID_SIZE), dtype=int)
    box_queue = deque()
    special_boxes = []  # List to store special boxes

    placed_boxes = 0
    special_boxes_count = 0
    
    while placed_boxes < INITIAL_GRID_BOXES:
        z = random.randint(0, GRID_SIZE-1)
        y = random.randint(0, GRID_SIZE-1)
        x = random.randint(0, GRID_SIZE-1)
        
        if z == 0 or grid[z-1, y, x] == 1:
            if grid[z, y, x] == 0:
                grid[z, y, x] = 1
                placed_boxes += 1
                
                # Mark 3 boxes as special boxes with sound level sensors
                if special_boxes_count < 3:
                    special_boxes.append((x, y, z))
                    special_boxes_count += 1
    
    for _ in range(INITIAL_QUEUE_BOXES):
        box_queue.append(1)
    
    return grid, box_queue, special_boxes

def create_boxes_from_queue(box_queue, start_pos, box_size, spacing):
    queue_boxes = []
    queue_length = len(box_queue)
    layers = queue_length // 15 + (1 if queue_length % 15 > 0 else 0)
    
    for i in range(queue_length):
        if box_queue[i] == 1:
            x = start_pos.X + (i % 3) * (box_size + spacing)
            y = start_pos.Y + ((i // 3) % 5) * (box_size + spacing)
            z = start_pos.Z + (i // 15) * (box_size + spacing)
            corner1 = rg.Point3d(x, y, z)
            corner2 = rg.Point3d(x + box_size, y + box_size, z + box_size)
            box = rg.Box(rg.BoundingBox(corner1, corner2))
            queue_boxes.append(box)
    
    return queue_boxes

def create_boxes_from_grid(grid, special_boxes):
    boxes = []
    # Iterate through the 3D numpy array
    for z in range(GRID_SIZE):
        for y in range(GRID_SIZE):
            for x in range(GRID_SIZE):
                if grid[z][y][x] == 1:
                    # Create a box at this position
                    corner1 = rg.Point3d(x * box_size, y * box_size, z * box_size)
                    corner2 = rg.Point3d((x + 1) * box_size, (y + 1) * box_size, (z + 1) * box_size)
                    box = rg.Box(rg.BoundingBox(corner1, corner2))
                    
                    # Check if this box is a special box
                    if (x, y, z) in special_boxes:
                        boxes.append((box, "special"))
                    else:
                        boxes.append((box, "normal"))
    return boxes

grid, box_queue, special_boxes = initialize_grid_and_queue()
grid_boxes = create_boxes_from_grid(grid, special_boxes)

x_Dis_spacing = 1
spacing = 0
# Define the start position for the queue boxes
start_pos = rg.Point3d(GRID_SIZE * box_size + x_Dis_spacing, 0, 0)
# Create boxes from the queue
queue_boxes = create_boxes_from_queue(box_queue, start_pos, box_size, spacing)

a = [box for box, _ in grid_boxes]  # Just the grid boxes
b = queue_boxes
special_grid_boxes = [box for box, tag in grid_boxes if tag == "special"]  # The special boxes with sound level sensors

# Output the special_grid_boxes to check if they are correctly identified
print("Special Grid Boxes:", special_grid_boxes)
print(type(grid))

rs.sticky["Init_grid"] = grid
rs.sticky["Init_box_queue"] = box_queue
rs.sticky["Init_special_boxes"] = special_boxes
# ---------- end python_3_script_7 ----------
python_3_script_8 = Python3Script()  # -> out, a, b; disabled
# ---------- python_3_script_8: Python ----------
import numpy as np
import random
from collections import deque
import Rhino.Geometry as rg

# Define the grid size
GRID_SIZE = 5
TOTAL_BOXES = 50
INITIAL_GRID_BOXES = 25
INITIAL_QUEUE_BOXES = TOTAL_BOXES - INITIAL_GRID_BOXES
boxes = []
box_size = 0.4  # Adjust the size of the boxes as needed

# Initialize the 3D grid with random scattered boxes (1 represents a box, 0 represents an empty space)
def initialize_grid_and_queue():
    grid = np.zeros((GRID_SIZE, GRID_SIZE, GRID_SIZE), dtype=int)
    box_queue = deque()
    
    placed_boxes = 0
    while placed_boxes < INITIAL_GRID_BOXES:
        z = random.randint(0, GRID_SIZE-1)
        y = random.randint(0, GRID_SIZE-1)
        x = random.randint(0, GRID_SIZE-1)
        
        if z == 0 or grid[z-1, y, x] == 1:
            if grid[z, y, x] == 0:
                grid[z, y, x] = 1
                placed_boxes += 1
    
    for _ in range(INITIAL_QUEUE_BOXES):
        box_queue.append(1)
    
    return grid, box_queue

def create_boxes_from_queue(box_queue, start_pos, box_size, spacing):
    queue_boxes = []
    queue_length = len(box_queue)
    layers = queue_length // 15 + (1 if queue_length % 15 > 0 else 0)
    
    for i in range(queue_length):
        if box_queue[i] == 1:
            x = start_pos.X + (i % 3) * (box_size + spacing)
            y = start_pos.Y + ((i // 3) % 5) * (box_size + spacing)
            z = start_pos.Z + (i // 15) * (box_size + spacing)
            corner1 = rg.Point3d(x, y, z)
            corner2 = rg.Point3d(x + box_size, y + box_size, z + box_size)
            box = rg.Box(rg.BoundingBox(corner1, corner2))
            queue_boxes.append(box)
    
    return queue_boxes

def create_boxes_from_grid(grid):
    # Iterate through the 3D numpy array
    for z in range(GRID_SIZE):
        for y in range(GRID_SIZE):
            for x in range(GRID_SIZE):
                if grid[z][y][x] == 1:
                    # Create a box at this position
                    corner1 = rg.Point3d(x * box_size, y * box_size, z * box_size)
                    corner2 = rg.Point3d((x + 1) * box_size, (y + 1) * box_size, (z + 1) * box_size)
                    box = rg.Box(rg.BoundingBox(corner1, corner2))
                    boxes.append(box)
    return boxes

grid, box_queue = initialize_grid_and_queue()
grid_boxes = create_boxes_from_grid(grid)

x_Dis_spacing = 1
spacing = 0
# Define the start position for the queue boxes
start_pos = rg.Point3d(GRID_SIZE * box_size + x_Dis_spacing, 0, 0)
# Create boxes from the queue
queue_boxes = create_boxes_from_queue(box_queue, start_pos, box_size, spacing)

a = grid_boxes
b = queue_boxes
# ---------- end python_3_script_8 ----------
python_3_script_9 = Python3Script()  # -> out, grid, queue, special_boxes; disabled
# ---------- python_3_script_9: Python ----------
import scriptcontext as sc
import numpy as np
from collections import deque
import random

# Constants
GRID_SIZE = 5
TOTAL_BOXES = 50
INITIAL_GRID_BOXES = 25
INITIAL_QUEUE_BOXES = TOTAL_BOXES - INITIAL_GRID_BOXES
SOUND_THRESHOLD = 100
MIN_SOUND_LEVEL = 50  # Minimum sound level to move item back to queue

# Function to move items between grid and queue based on sound levels
def move_items(grid, queue, special_boxes, sound_levels):
    # Move items from queue to grid
    for x, y, z in special_boxes:
        sound_key = f"Sound_Level_{z + 1:02d}"
        sound_level = sc.sticky.get(sound_key, 0)  # Get sound level from sticky, default to 0 if not found
        
        if sound_level > SOUND_THRESHOLD:
            adj_positions = adjacent_positions(x, y, z)
            for adj_x, adj_y, adj_z in adj_positions:
                if grid[adj_x][adj_y][adj_z] == 0 and queue:
                    grid[adj_x][adj_y][adj_z] = queue.popleft()
                    sound_levels[adj_x][adj_y][adj_z] = sound_level
                    break

    # Move items from grid back to queue and apply gravity rule
    for y in range(GRID_SIZE):
        for x in range(GRID_SIZE):
            # Collect all boxes in the column (x, y)
            column_boxes = []
            for z in range(GRID_SIZE):
                if grid[x][y][z] == 1:
                    column_boxes.append(z)
                    grid[x][y][z] = 0  # Clear the grid position
            
            # Move boxes in the column to the lowest possible position
            for z in sorted(column_boxes):
                if sound_levels[x][y][z] < MIN_SOUND_LEVEL:
                    queue.append(1)  # Move box to queue
                else:
                    grid[x][y][z] = 1  # Place box in the grid
                    sound_levels[x][y][z] = sound_levels[x][y][z]  # Retain sound level

# Function to find adjacent positions in the grid
def adjacent_positions(x, y, z):
    adjacent = []
    for dx in [-1, 0, 1]:
        for dy in [-1, 0, 1]:
            for dz in [-1, 0, 1]:
                if (dx != 0 or dy != 0 or dz != 0) and 0 <= x + dx < GRID_SIZE and 0 <= y + dy < GRID_SIZE and 0 <= z + dz < GRID_SIZE:
                    adjacent.append((x + dx, y + dy, z + dz))
    return adjacent

# Retrieve initial states from Grasshopper's sticky
grid = sc.sticky["Init_grid"]
queue = deque(sc.sticky["Init_box_queue"])
special_boxes = sc.sticky["Init_special_boxes"]
sound_levels = sc.sticky.get("sound_levels", np.zeros((GRID_SIZE, GRID_SIZE, GRID_SIZE), dtype=float))

# Move items between grid and queue based on current sound levels and apply gravity
move_items(grid, queue, special_boxes, sound_levels)

# Update the sticky with the modified states
sc.sticky["Init_grid"] = grid
sc.sticky["Init_box_queue"] = queue
sc.sticky["sound_levels"] = sound_levels
# ---------- end python_3_script_9 ----------

# ---- group: Random set special boxes & Assign Sound Level Sensor
python_3_script_10 = Python3Script(Random_Set=Button())  # -> out, all_boxes, grid_special_boxes, grid_normal_boxes, queue_special_boxes, queue_normal_boxes; inputs Random_Set: Boolean
# ---------- python_3_script_10: Python ----------
import random
import datetime
import numpy as np
import Rhino.Geometry as rg
import scriptcontext as sc
from collections import deque
from Box import Box

def Random_Set_Special_Boxes(num_special):
    """
    Randomly set some boxes in the all_boxes list to 'special'.
    
    Parameters:
        num_special (int): Number of boxes to set as 'special'.
        
    Raises:
        ValueError: If num_special is greater than the length of all_boxes.
    """
    all_boxes = sc.sticky["all_boxes"]
    for Box in all_boxes:
        Box.type = "normal"
    if num_special > len(all_boxes):
        raise ValueError("num_special cannot be greater than the number of boxes in all_boxes.")
    
    # Select random indices for the boxes to be set as special
    special_indices = random.sample(range(len(all_boxes)), num_special)
    
    for i in special_indices:
        box = all_boxes[i]
        
        # Only update boxes that are currently 'normal'
        if box.type == 'normal':
            box.type = 'special'

    return all_boxes

def Assign_Sound_Sensor():
    all_boxes = sc.sticky["all_boxes"]
    # Filter special boxes
    special_boxes = [box for box in all_boxes if box.type == "special"]
    
    # Check if there are enough sensors for the special boxes
    if len(special_boxes) > len(Box.VALID_SENSORS):
        raise ValueError("Not enough sound sensors for the number of special boxes.")
    
    # Shuffle the list of VALID_SENSORS
    shuffled_sensors = list(Box.VALID_SENSORS)
    random.shuffle(shuffled_sensors)
    
    # Assign each special box a unique sound sensor
    for i, box in enumerate(special_boxes):
        box.sound_sensor = shuffled_sensors[i]
    
    return all_boxes

if "Init" not in globals():
    Init = True
    last_RandomSetTime = "No time!"

if Random_Set:
    # Get the current time
    current_time = datetime.datetime.now()
    datetime_str = current_time.strftime("%Y-%m-%d %H:%M:%S")
    last_RandomSetTime = datetime_str
    # Format the current time as YYYYMMDDHHMMSS
    formatted_time = current_time.strftime('%Y%m%d%H%M%S%f')

    # Random set special boxes
    all_boxes = Random_Set_Special_Boxes(3)

    # Assign sound sensor to special boxes
    all_boxes = Assign_Sound_Sensor()

    sc.sticky["all_boxes"] = all_boxes
    print("Random set at " + last_RandomSetTime)
else:
    #do other things
    print("Random set at " + last_RandomSetTime)


all_boxes = sc.sticky["all_boxes"]
grid_special_boxes=[]
grid_normal_boxes=[]
queue_special_boxes=[]
queue_normal_boxes=[]
for Box in all_boxes:
    if Box.category == "grid" and Box.type == "special":
        grid_special_boxes.append(Box)
    elif Box.category == "grid" and Box.type == "noemal":
        grid_normal_boxes.append(Box)
    elif Box.category == "queue" and Box.type == "special":
        queue_special_boxes.append(Box)
    else:
        queue_normal_boxes.append(Box)

print(f"There are {len(grid_special_boxes)+len(queue_special_boxes)} 'special' boxes.")
# ---------- end python_3_script_10 ----------
panel_6 = Panel(python_3_script_10.out)

# ----
python_3_script_11 = Python3Script(clear=Button())  # -> out; inputs clear: Boolean
# ---------- python_3_script_11: Python ----------
import scriptcontext as rs
import datetime


if "Init" not in globals():
    Init = True
    last_ClearTime = "No time!"
if clear:
    # Get the current time
    current_time = datetime.datetime.now()
    datetime_str = current_time.strftime("%Y-%m-%d %H:%M:%S")
    last_ClearTime = datetime_str
    # Format the current time as YYYYMMDDHHMMSS
    formatted_time = current_time.strftime('%Y%m%d%H%M%S%f')

    # Clear all sticky values
    rs.sticky.clear()
    print("sticky cleared at " + datetime_str)
else:
    print("sticky cleared at " + last_ClearTime)
# ---------- end python_3_script_11 ----------
python_3_script_12 = Python3Script(button_state=Button(), reset_trigger=Button())  # -> out, a, c; inputs reset_trigger: Boolean
# ---------- python_3_script_12: Python ----------
import Rhino.Geometry as rg
import ghpythonlib.treehelpers as th

# Check if 'b' exists as a component attribute, initialize to 0 if not
if "b" not in globals():
    b = 0

# Input button_state is the boolean input connected to the Boolean Button component
# It should be a single boolean value

# Input reset_trigger is the boolean input connected to the Reset Button component
# It should also be a single boolean value

if reset_trigger:
    # Reset 'b' and 'c' to initial values
    b = 0
    c = 0
    # Reset the reset_trigger to False after execution
    reset_trigger = False
elif button_state:
    # Execute your script logic here
    # This code block will run only once when button_state is True
    # Ensure you handle all necessary inputs and outputs within this block
    b = b + 1  # Increment 'b' each time the button is pressed

    # Example logic:
    a = "Script executed once"

    # Reset the button_state to False after execution
    button_state = False
else:
    # Handle the case when button_state is False, if needed
    a = "Waiting for button press"
c = b
# ---------- end python_3_script_12 ----------

# ---- group: 3 in juxtaposition (returns prematurely issue)
# Issue: To solve the problem where the detect_and_relocate() method returns prematurely when a box is supported but the box above it will become unsupported after moving, you need to ensure that all possible box movements are checked, even if one fails. One approach is to keep track of boxes that can be moved and check for unsupported boxes afterward.
python_3_script_13 = Python3Script()  # -> out, a
# ---------- python_3_script_13: Python ----------
import random
import Rhino.Geometry as rg
from Box import Box

def detect_and_relocate():
    # Define the number of decimal places to round to
    precision = 3
    # Define a small tolerance value for floating-point comparisons
    tolerance = 1e-3

    # Find all grid boxes
    grid_boxes = [box for box in Box.instances if box.category == 'grid']
    
    # Sort boxes by position for easier comparison
    grid_boxes.sort(key=lambda box: (round(box.position.X, precision), round(box.position.Y, precision), round(box.position.Z, precision)))
    
    # Create a 3D dictionary to store the positions of the grid boxes
    grid_dict = {}
    for box in grid_boxes:
        x = round(box.position.X, precision)
        y = round(box.position.Y, precision)
        z = round(box.position.Z, precision)
        if (x, y, z) not in grid_dict:
            grid_dict[(x, y, z)] = box

    # Helper function to check if three boxes are adjacent in a direction
    def are_boxes_adjacent(box1, box2, box3, axis):
        if axis == 'x':
            return round(abs(box1.position.X - box2.position.X), precision) == Box.size and round(abs(box2.position.X - box3.position.X), precision) == Box.size
        elif axis == 'y':
            return round(abs(box1.position.Y - box2.position.Y), precision) == Box.size and round(abs(box2.position.Y - box3.position.Y), precision) == Box.size
        elif axis == 'z':
            return round(abs(box1.position.Z - box2.position.Z), precision) == Box.size and round(abs(box2.position.Z - box3.position.Z), precision) == Box.size
        return False

    # Helper function to check if a box is supported
    def is_supported(x, y, z):
        # A box is supported if it is on the ground or there is another box directly beneath it
        return z == 0 or (x, y, round(z - Box.size, precision)) in grid_dict

    # Initialize box_to_move as None
    box_to_move = None

    x = 0.4
    y = 0.8
    z = 0.4
    test = grid_dict[(x, y, z)]
    a1 = (round(x + Box.size, precision), y, z) in grid_dict
    a2 = (round(x + 2 * Box.size, precision), y, z) in grid_dict

    # Iterate through the grid to find three adjacent boxes
    for (x, y, z) in grid_dict.keys():
        # Check x-direction
        if (round(x + Box.size, precision), y, z) in grid_dict and (round(x + 2 * Box.size, precision), y, z) in grid_dict:
            box1 = grid_dict[(x, y, z)]
            box2 = grid_dict[(round(x + Box.size, precision), y, z)]
            box3 = grid_dict[(round(x + 2 * Box.size, precision), y, z)]
            if are_boxes_adjacent(box1, box2, box3, 'x'):
                box_to_move = random.choice([box1, box2, box3])
                break
        
        # Check y-direction
        if (x, round(y + Box.size, precision), z) in grid_dict and (x, round(y + 2 * Box.size, precision), z) in grid_dict:
            box1 = grid_dict[(x, y, z)]
            box2 = grid_dict[(x, round(y + Box.size, precision), z)]
            box3 = grid_dict[(x, round(y + 2 * Box.size, precision), z)]
            if are_boxes_adjacent(box1, box2, box3, 'y'):
                box_to_move = random.choice([box1, box2, box3])
                break        

    # Proceed only if a box has been selected to move
    if box_to_move:
        # Check if removing the box would cause any floating boxes
        x, y, z = round(box_to_move.position.X, precision), round(box_to_move.position.Y, precision), round(box_to_move.position.Z, precision)
        if is_supported(x, y, z):
            # Remove the box
            del grid_dict[(x, y, z)]
            
            # Check if all boxes above are still supported
            for (bx, by, bz) in list(grid_dict.keys()):
                if bx == x and by == y and bz > z and not is_supported(bx, by, bz):
                    return  # Cancel the move if any box above is floating

            box_to_move.category = 'queue'
            
            # Update counters
            Box.num_boxes_grid -= 1
            Box.num_boxes_queue += 1
            
            grid_len_x = 2
            spacing = 2 * Box.size
            # Determine new position based on queue indexing logic
            queue_boxes = [box for box in Box.instances if box.category == 'queue']
            queue_boxes.sort(key=lambda box: (round(box.position.X, precision), round(box.position.Y, precision), round(box.position.Z, precision)))
            index = len(queue_boxes) - 1

            new_x_position = grid_len_x + spacing + index // 15 * Box.size
            new_y_position = (index % 15) // 3 * Box.size
            new_z_position = (index % 15) % 3 * Box.size
            
            box_to_move.position = rg.Point3d(new_x_position, new_y_position, new_z_position)

detect_and_relocate()
# ---------- end python_3_script_13 ----------

# ----
panel_7 = Panel(python_3_script_7.grid)  # disabled
panel_8 = Panel(python_3_script_11)
python_3_script_14 = Python3Script()  # -> out, a, b, c
# ---------- python_3_script_14: Python ----------
from Box import Box
import random
import scriptcontext as sc

list_b=[]
for b in Box.instances:
    if b.category == "queue":
        list_b.append(b)
a = len(list_b)
c = len(Box.instances)
"""
c = []
all_boxes = sc.sticky["all_boxes"]

for Box in all_boxes:
    if Box.type == "special":
        c.append(Box)
"""
# ---------- end python_3_script_14 ----------
panel_9 = Panel(python_3_script_9.out)  # disabled
panel_10 = Panel(python_3_script_9.grid)  # disabled
panel_11 = Panel(python_3_script_8.a)  # disabled
characters = Characters(Text=python_3_script_7.special_boxes)  # -> Result, Unicode; disabled
custom_preview = CustomPreview(
    Geometry=python_3_script_7.special_grid_boxes,
    Material={diffuse=RGB(221, 160, 221), emission=RGB(66, 48, 66), shine=0.5, specular=RGB(255, 255, 255), transparency=0})  # disabled
panel_12 = Panel(python_3_script_12.a)
panel_13 = Panel(python_3_script_12.c)
panel_14 = Panel("""-1
0""")  # disabled
panel_15 = Panel(python_3_script_14.a)
panel_16 = Panel(python_3_script_14.b)
panel_17 = Panel(python_3_script_14.c)
panel_18 = Panel(python_3_script_9.special_boxes)  # disabled
cull_index = CullIndex(List=characters.Result, Indices=panel_14, Wrap=True)  # disabled

# ---- group: 3 in juxtaposition (no issue)
python_3_script_15 = Python3Script()  # -> out, a
# ---------- python_3_script_15: Python ----------
import random
import Rhino.Geometry as rg
from Box import Box

def detect_and_relocate():
    # Define the number of decimal places to round to
    precision = 3
    # Define a small tolerance value for floating-point comparisons
    tolerance = 1e-3

    # Find all grid boxes
    grid_boxes = [box for box in Box.instances if box.category == 'grid']
    
    # Sort boxes by position for easier comparison
    grid_boxes.sort(key=lambda box: (round(box.position.X, precision), round(box.position.Y, precision), round(box.position.Z, precision)))
    
    # Create a 3D dictionary to store the positions of the grid boxes
    grid_dict = {}
    for box in grid_boxes:
        x = round(box.position.X, precision)
        y = round(box.position.Y, precision)
        z = round(box.position.Z, precision)
        if (x, y, z) not in grid_dict:
            grid_dict[(x, y, z)] = box

    # Helper function to check if three boxes are adjacent in a direction
    def are_boxes_adjacent(box1, box2, box3, axis):
        if axis == 'x':
            return round(abs(box1.position.X - box2.position.X), precision) == Box.size and round(abs(box2.position.X - box3.position.X), precision) == Box.size
        elif axis == 'y':
            return round(abs(box1.position.Y - box2.position.Y), precision) == Box.size and round(abs(box2.position.Y - box3.position.Y), precision) == Box.size
        elif axis == 'z':
            return round(abs(box1.position.Z - box2.position.Z), precision) == Box.size and round(abs(box2.position.Z - box3.position.Z), precision) == Box.size
        return False

    # Helper function to check if a box is supported
    def is_supported(x, y, z):
        # A box is supported if it is on the ground or there is another box directly beneath it
        return z == 0 or (x, y, round(z - Box.size, precision)) in grid_dict

    # Initialize a list to keep track of potential boxes to move
    potential_moves = []

    # Iterate through the grid to find three adjacent boxes
    for (x, y, z) in grid_dict.keys():
        # Check x-direction
        if (round(x + Box.size, precision), y, z) in grid_dict and (round(x + 2 * Box.size, precision), y, z) in grid_dict:
            box1 = grid_dict[(x, y, z)]
            box2 = grid_dict[(round(x + Box.size, precision), y, z)]
            box3 = grid_dict[(round(x + 2 * Box.size, precision), y, z)]
            if are_boxes_adjacent(box1, box2, box3, 'x'):
                potential_moves.append(random.choice([box1, box2, box3]))
        
        # Check y-direction
        if (x, round(y + Box.size, precision), z) in grid_dict and (x, round(y + 2 * Box.size, precision), z) in grid_dict:
            box1 = grid_dict[(x, y, z)]
            box2 = grid_dict[(x, round(y + Box.size, precision), z)]
            box3 = grid_dict[(x, round(y + 2 * Box.size, precision), z)]
            if are_boxes_adjacent(box1, box2, box3, 'y'):
                potential_moves.append(random.choice([box1, box2, box3]))

    # Check each potential move
    for box_to_move in potential_moves:
        # Check if removing the box would cause any floating boxes
        x, y, z = round(box_to_move.position.X, precision), round(box_to_move.position.Y, precision), round(box_to_move.position.Z, precision)
        if is_supported(x, y, z):
            # Temporarily remove the box
            del grid_dict[(x, y, z)]
            
            # Check if all boxes above are still supported
            unsupported_boxes = [(bx, by, bz) for (bx, by, bz) in grid_dict.keys() if bx == x and by == y and bz > z and not is_supported(bx, by, bz)]
            
            if not unsupported_boxes:
                # If no unsupported boxes, perform the move
                box_to_move.category = 'queue'
                
                # Update counters
                Box.num_boxes_grid -= 1
                Box.num_boxes_queue += 1
                
                grid_len_x = 2
                spacing = 2 * Box.size
                # Determine new position based on queue indexing logic
                queue_boxes = [box for box in Box.instances if box.category == 'queue']
                queue_boxes.sort(key=lambda box: (round(box.position.X, precision), round(box.position.Y, precision), round(box.position.Z, precision)))
                index = len(queue_boxes) - 1

                new_x_position = grid_len_x + spacing + index // 15 * Box.size
                new_y_position = (index % 15) // 3 * Box.size
                new_z_position = (index % 15) % 3 * Box.size
                
                box_to_move.position = rg.Point3d(new_x_position, new_y_position, new_z_position)
                return  # Move is completed

            # Re-add the box if the move is not valid
            grid_dict[(x, y, z)] = box_to_move

# Example of using the function
detect_and_relocate()
# ---------- end python_3_script_15 ----------

# ---- group: Initialize_BoxInstances
python_3_script_16 = Python3Script(grid=python_3_script_4.grid, box_queue=python_3_script_4.box_queue)  # -> out, all_boxes, grid_boxes, queue_boxes
# ---------- python_3_script_16: Python ----------
import numpy as np
import random
import scriptcontext as sc
import Rhino.Geometry as rg
from collections import deque
from Box import Box

# Function to instantiate boxes from the grid data
def instantiate_boxes_from_grid(grid_data):
    boxes = []

    for z in range(grid_data.shape[0]):
        for y in range(grid_data.shape[1]):
            for x in range(grid_data.shape[2]):
                if grid_data[z, y, x] == 1:
                    position = rg.Point3d(round(x * Box.size, 4), round(y * Box.size, 4), round(z * Box.size,4))  # Create Rhino.Geometry.Point3d
                    category = 'grid'

                    box = Box(position, category)
                    boxes.append(box)

    return boxes

# Function to generate boxes in the queue
def generate_queue_boxes(box_queue, grid_size_x, spacing=Box.size):
    queue_boxes = []
    offset_x = grid_size_x * Box.size + spacing  # Position along +x axis side of the grid

    index = 0
    for i in range(len(box_queue) // 15 + 1):
        for y in range(5):
            for z in range(3):
                if index < len(box_queue):
                    position = rg.Point3d(round(offset_x + i * Box.size, 4), round(y * Box.size, 4), round(z * Box.size, 4))
                    box = Box(position, 'queue')
                    queue_boxes.append(box)
                    index += 1
                else:
                    break

    return queue_boxes





Box.clear_instances()

# Define the new 5x5x5 grid as a numpy array
grid_data = grid

# Instantiate boxes from grid data
grid_boxes = instantiate_boxes_from_grid(grid_data)

# Box queue data
box_queue = box_queue

# Generate queue boxes
queue_boxes = generate_queue_boxes(box_queue, grid_size_x=5, spacing=Box.size*2)

# Combine all boxes
all_boxes = grid_boxes + queue_boxes

sc.sticky["all_boxes"] = all_boxes
# ---------- end python_3_script_16 ----------

# ----
text_join = TextJoin(Text=cull_index)  # disabled
panel_19 = Panel(",")  # disabled
text_split = TextSplit(Text=text_join, Separators=panel_19)  # disabled

# ---- group: Real-time_Visualizing
trigger_4 = Trigger(Interval=100, TimerInterval=100, Target=python_3_script_17)
python_3_script_17 = Python3Script()  # -> out, pos_all, pos_special
# ---------- python_3_script_17: Python ----------
import scriptcontext as sc

pos_all=[]
pos_special=[]
special_boxes=[]
all_boxes = sc.sticky["all_boxes"]

for box in all_boxes:
    pos_all.append(box.position)
    if box.type == "special":
        special_boxes.append(box)
        pos_special.append(box.position)
# ---------- end python_3_script_17 ----------
construct_domain = ConstructDomain(DomainStart=0, DomainEnd=Slider(0.4, range=0..1))
domain_box = DomainBox(Base=python_3_script_17.pos_all, X=construct_domain, Y=construct_domain, Z=construct_domain)
domain_box_2 = DomainBox(Base=python_3_script_17.pos_special, X=construct_domain, Y=construct_domain, Z=construct_domain)
custom_preview_2 = CustomPreview(
    Geometry=domain_box_2,
    Material={diffuse=RGB(221, 160, 221), emission=RGB(66, 48, 66), shine=0.5, specular=RGB(255, 255, 255), transparency=0})

# ----
trigger_5 = Trigger(Interval=100, TimerInterval=100, Target=python_3_script_18)
list_item = ListItem(List=text_split, Index=0, Wrap=True)  # -> Item, Item1, Item2; disabled
number_slider_4 = Slider(0.4, range=0..1)  # disabled
python_3_script_18 = Python3Script()  # -> out
# ---------- python_3_script_18: Python ----------
import random
import scriptcontext as sc

Sound_Level_01 = round(random.uniform(30,100), 2)
Sound_Level_02 = round(random.uniform(30,100), 2)
Sound_Level_03 = round(random.uniform(30,100), 2)

print(Sound_Level_01)
print(Sound_Level_02)
print(Sound_Level_03)

sc.sticky["Sound_Level_01"] = Sound_Level_01
sc.sticky["Sound_Level_02"] = Sound_Level_02
sc.sticky["Sound_Level_03"] = Sound_Level_03
# ---------- end python_3_script_18 ----------
construct_point = ConstructPoint(XCoordinate=list_item.Item, YCoordinate=list_item.Item1, ZCoordinate=list_item.Item2)  # disabled
panel_20 = Panel(python_3_script_18)
scale = Scale(Geometry=construct_point, Center=Point(0, 0, 0), Factor=number_slider_4)  # -> Geometry, Transform; disabled
list_length = ListLength(List=python_3_script_17.pos_all)
series = Series(Start=0, Step=1, Count=list_length)
serialize_keys_and_values = SerializeKeysAndValues(Key=series, Value=python_3_script_17.pos_all)
network_source = NetworkSource()  # -> NetworkAdapterIsUp, AdapterProperties, LocalIpAddress
json_to_xml = JSONToXML(JSON=serialize_keys_and_values)
udp_sender = UDPSender(Address=network_source.LocalIpAddress, Port="8765", Pattern=0, Data=json_to_xml)
network_source_2 = NetworkSource()  # -> NetworkAdapterIsUp, AdapterProperties, LocalIpAddress
udp_receiver_4 = UDPReceiver(Port="12399", Pattern=0)  # -> Info, Data
panel_21 = Panel(network_source_2.LocalIpAddress)
text_split_2 = TextSplit(Text=udp_receiver_4.Data, Separators=";")
text_split_3 = TextSplit(Text=text_split_2, Separators=":")
list_item_2 = ListItem(List=reverse(text_split_3), Index=0, Wrap=True)
list_item_3 = ListItem(List=text_split_3, Index=0, Wrap=True)
text_split_4 = TextSplit(Text=list_item_2, Separators=",")
flatten_tree = FlattenTree(Tree=list_item_3, Path="{0}")
list_item_4 = ListItem(List=reverse(text_split_4), Index=0, Wrap=True)
list_item_5 = ListItem(List=text_split_4, Index=0, Wrap=True)  # -> Item, Item1, Item2
construct_point_2 = ConstructPoint(XCoordinate=list_item_5.Item, YCoordinate=list_item_5.Item2, ZCoordinate=list_item_5.Item1)
flatten_tree_2 = FlattenTree(Tree=list_item_4, Path="{0}")
flatten_tree_3 = FlattenTree(Tree=construct_point_2, Path="{0}")
jointsname_list = Data(flatten_tree)
confidence_list = Data(flatten_tree_2)
jointspoint_list = Data(flatten_tree_3)
panel_22 = Panel(jointsname_list)
panel_23 = Panel(confidence_list)
smaller_than = SmallerThan(FirstNumber=confidence_list, SecondNumber=Slider(0.1, range=0..0.1))  # -> SmallerThan, OrEqualTo
sift_pattern = SiftPattern(List=jointspoint_list, SiftPattern=smaller_than.SmallerThan)  # -> Output0, Output1
point = Point(sift_pattern.Output0)
point_2 = Point(<point referenced from the Rhino model>)
curve = Curve(<curve referenced from the Rhino model>)
curve_2 = Curve(<curve referenced from the Rhino model>)
point_3 = Point(<point referenced from the Rhino model>)
curve_3 = Curve(<curve referenced from the Rhino model>)
curve_4 = Curve(<curve referenced from the Rhino model>)
construct_plane = ConstructPlane(Origin=point_2, XAxis=curve, YAxis=curve_2)
construct_plane_2 = ConstructPlane(Origin=point_3, XAxis=curve_3, YAxis=curve_4)
orient = Orient(Geometry=jointspoint_list, Source=construct_plane, Target=construct_plane_2)  # -> Geometry, Transform
point_4 = Point(orient.Geometry)
panel_24 = Panel(point_4)
panel_25 = Panel("""2
4
5""")
panel_26 = Panel("""0
1
2""")
panel_27 = Panel("""2
6
8
10
12""")
panel_28 = Panel("""3
7
9
11
13""")
panel_29 = Panel("""5
14
16
18""")
panel_30 = Panel("""5
15
17
19""")
list_item_6 = ListItem(List=point_4, Index=panel_26, Wrap=True)
list_item_7 = ListItem(List=point_4, Index=panel_25, Wrap=True)
list_item_8 = ListItem(List=point_4, Index=panel_27, Wrap=True)
list_item_9 = ListItem(List=point_4, Index=panel_28, Wrap=True)
list_item_10 = ListItem(List=point_4, Index=panel_29, Wrap=True)
list_item_11 = ListItem(List=point_4, Index=panel_30, Wrap=True)
polyline = PolyLine(Vertices=list_item_7, Closed=False)
polyline_2 = PolyLine(Vertices=list_item_6, Closed=False)
polyline_3 = PolyLine(Vertices=list_item_8, Closed=False)
polyline_4 = PolyLine(Vertices=list_item_9, Closed=False)
polyline_5 = PolyLine(Vertices=list_item_10, Closed=False)
polyline_6 = PolyLine(Vertices=list_item_11, Closed=False)
