# Grasshopper definition PointListFromR8(OpenWith_R7).gh (Grasshopper 1.0.7)
# plug-ins: gHowl, jSwan

network_source = NetworkSource()  # -> NetworkAdapterIsUp, AdapterProperties, LocalIpAddress
udp_receiver = UDPReceiver(Address=network_source.LocalIpAddress, Port="8765", Pattern=0)  # -> Info, Data
xml_to_json = XMLToJSON(XML=udp_receiver.Data)
deserialize_json = DeserializeJson(JSON=xml_to_json, OutputsLocked=False)  # -> Xml, Root
text_split = TextSplit(Text=deserialize_json.Root)
dispatch = Dispatch(List=text_split, DispatchPattern=[True, False])  # -> ListA, ListB
panel = Panel("""-1
0""")
cull_index = CullIndex(List=dispatch.ListA, Indices=panel, Wrap=True)
partition_list = PartitionList(List=cull_index, Size="5")
panel_2 = Panel("""-1
0""")
cull_index_2 = CullIndex(List=partition_list, Indices=panel_2, Wrap=True)
text_join = TextJoin(Text=cull_index_2)
text_split_2 = TextSplit(Text=text_join, Separators=",")
text_split_3 = TextSplit(Text=text_split_2, Separators=":")
simplify_tree = SimplifyTree(Tree=text_split_3, Front=False)
shift_paths = ShiftPaths(Data=simplify_tree, Offset=-1)
dispatch_2 = Dispatch(List=shift_paths, DispatchPattern=[True, False])  # -> ListA, ListB
characters = Characters(Text=dispatch_2.ListB)  # -> Result, Unicode
panel_3 = Panel("""-1
0
1""")
cull_index_3 = CullIndex(List=characters.Result, Indices=panel_3, Wrap=True)
text_join_2 = TextJoin(Text=cull_index_3)
number_slider = Slider(0.4, range=0..1)  # disabled
simplify_tree_2 = SimplifyTree(Tree=text_join_2, Front=False)
shift_paths_2 = ShiftPaths(Data=simplify_tree_2, Offset=-1)
construct_domain = ConstructDomain(DomainStart=0, DomainEnd=number_slider)  # disabled
list_item = ListItem(List=shift_paths_2, Index=0, Wrap=True)  # -> Item, Item1, Item2
construct_point = ConstructPoint(XCoordinate=list_item.Item, YCoordinate=list_item.Item1, ZCoordinate=list_item.Item2)
domain_box = DomainBox(Base=construct_point, X=construct_domain, Y=construct_domain, Z=construct_domain)  # disabled
domain_box_2 = DomainBox(Base=PlaneXY(0, 0, 0), X=construct_domain, Y=construct_domain, Z=construct_domain)  # disabled
custom_preview = CustomPreview(
    Geometry=domain_box_2,
    Material={diffuse=RGB(221, 160, 221), emission=RGB(66, 48, 66), shine=0.5, specular=RGB(255, 255, 255), transparency=0})  # disabled
panel_4 = Panel(construct_point)
